# Grasshopper definition Yubo Zhao_A1.gh (Grasshopper 1.0.7)

point = Point(<point referenced from the Rhino model>)
c_script = CSharpScript(
    start=point,
    size=Slider(4.8, range=0..50),
    degree=Slider(0.162, range=0..1),
    res=Slider(3, range=0..10),
    density=Slider(5, range=0..10))  # -> out, polyline, timecost, length, text, A, B; inputs start: Point3d, size: Double, degree: Double, res: Int32, density: Int32
# ---------- c_script: C# ----------
    Grid g = new Grid(res, size, start);
    double length = size / (res - 1);
    int nunmberOfTurns = density;
    double dis = length / (density * 2);

    List<string> text = new List<string>();
    text.Add("start milling");


    int n = 0;
    Polyline result = new Polyline();
    while (n < res - 1){
      Point3d pt = g.GetCoordinate(n, 0).origin;
      Weaving w = new Weaving(pt, dis, length, degree);
      Polyline onePoly = MulWeaving(w, density * (res - 1));
      result.AddRange(onePoly);
      //Point3d lastPt = onePoly[-1];

      result.Add(pt);
      //result.Add(g.GetCoordinate(n + 1, 0).origin);
      n++;
    }

    g.TranslateGrid(new Vector3d(0.0, 0.0, -0.2));

    A = g.DrawGridPts();
    B = g.DrawGridLne();
    result.AddRange(g.DrawGridLne());

    result.MergeColinearSegments(0.01, false);

    double time = result.Length + result.Count * 3;

    text.Add("end milling");
    _polyline = result;
    _text = text;
    _length = result.Length;
    _timecost = time;
# ---------- c_script: C# additional code ----------
  //An enum for documenting the positional status of each Coordinate.
  public enum Position {
    Inner,
    OuterX,
    OuterY,
    Vertex
  }

  //A Coordinate class that documents a point coordinate and its X,Y indices.
  class Coordinate {
    public int iX, iY;
    public Point3d origin;
    public Position pos {get;set;}

    public void ChangePosStatus(Position p) {
      this.pos = p;
    }

    public Coordinate() {
      iX = 0;
      iY = 0;
      origin = new Point3d();
    }
    public Coordinate(int x, int y, Point3d pt) {
      this.iX = x;
      this.iY = y;
      this.origin = pt;
    }
    public void ChangeIndex (int x, int y) {
      this.iX = x;
      this.iY = y;
    }
    public Point3d DrawPt() {
      return this.origin;
    }
    public void Translate (Vector3d v) {
      this.origin = this.origin + v;
    }
  }

  //A grid class that is defined by int res, double size, and a list of Coordinates.
  class Grid {
    public double size;
    public int res;
    public List<Coordinate> cLst = new List<Coordinate>();

    public Grid() {
      size = 0.0;
      res = 0;
    }

    public Grid(int res, double size, Point3d start) {
      this.size = size;
      this.res = res;
      double interval = size / (res - 1);
      List<Coordinate> cLst = new List<Coordinate>();
      for (int i = 0; i < res; i++) {
        for (int j = 0; j < res; j++) {
          Coordinate c = new Coordinate(i, j, new Point3d(i * interval + start.X, j * interval + start.Y, start.Z));
          if (c.iX == res - 1 && c.iY == res - 1) {
            c.ChangePosStatus(Position.Vertex);
          } else if(c.iX == res - 1 && c.iY < res - 1) {
            c.ChangePosStatus(Position.OuterX);
          } else if (c.iY == res - 1 && c.iX < res - 1) {
            c.ChangePosStatus(Position.OuterY);
          } else {
            c.ChangePosStatus(Position.Inner);
          }
          cLst.Add(c);
        }
      }
      this.cLst = cLst;
    }

    public void ChangeRes(int r) {
      this.res = r;
      foreach (Coordinate c in this.cLst) {
        if (c.iX == r - 1 && c.iY == r - 1) {
          c.ChangePosStatus(Position.Vertex);
        } else if(c.iX == r - 1 && c.iY < r - 1) {
          c.ChangePosStatus(Position.OuterX);
        } else if (c.iY == r - 1 && c.iX < r - 1) {
          c.ChangePosStatus(Position.OuterY);
        } else {
          c.ChangePosStatus(Position.Inner);
        }
      }
    }

    public void ChangeSize(double s) {
      this.size = s;
    }

    public Coordinate GetCoordinate(int x, int y) {
      List<Coordinate> cLst = this.cLst;
      foreach (Coordinate c in cLst) {
        if (c.iX == x && c.iY == y) {
          return c;
        }
      }
      return new Coordinate();
    }

    public List<Point3d> DrawGridPts() {
      List<Coordinate> newLst = this.cLst;
      List<Point3d> result = new List<Point3d>();
      foreach (Coordinate item in newLst) {
        result.Add(item.DrawPt());
      }
      return result;
    }

    public void TranslateGrid(Vector3d v) {
      foreach (Coordinate c in this.cLst) {
        c.origin = c.origin + v;
      }
    }

    public Polyline DrawGridLne() {
      List<Point3d> pts = this.DrawGridPts();
      Polyline result = new Polyline();
      int k = 0;

      Point3d temp_pt = this.GetCoordinate(0, 0).origin;
      for(int j = 0; j < res; j++){
        for(int i = 0; i < res; i++){
          if(j % 2 == 0){
            temp_pt = pts[k];
            result.Add(temp_pt);
          }else{
            temp_pt = pts[k + res - 1 - 2 * i];
            result.Add(temp_pt);

          }
          k++;
        }
      }
      result.Add(this.GetCoordinate(0, res - 1).origin);
      result.Add(this.GetCoordinate(0, 0).origin);

      int l = 0;
      temp_pt = this.GetCoordinate(0, 0).origin;
      for(int j = 0; j < res; j++){
        for(int i = 0; i < res; i++){
          if(j % 2 == 0){
            temp_pt = pts[i * res + j];
            result.Add(temp_pt);
          }else{
            temp_pt = pts[l + (res - j) * (res - 1) - i * (res + 1)];
            result.Add(temp_pt);

          }
          l++;
        }
      }

      return result;
    }
  }

  //A Weaving class of the polyline moving along z-axis.
  public class Weaving {
    public Point3d start = new Point3d();
    public Point3d end = new Point3d();
    public double dis;
    public double length;
    public double degree;

    public Weaving() {
    }

    public Weaving(Point3d start, double dis, double length, double degree) {
      this.start = start;
      this.end = new Point3d(start.X, start.Y + dis * 2.0, start.Z);
      this.dis = dis;
      this.length = length;
      this.degree = degree;
    }

    public void ChangeStart() {
      Point3d newStart = this.end;
      this.start = newStart;
      this.end = new Point3d(this.start.X, this.start.Y + dis * 2.0, this.start.Z);
    }

    public Polyline DrawOne () {
      Polyline poly = new Polyline();
      double dz = Math.Tan(this.length) * Math.PI * this.degree;
      poly.Add(this.start);
      Point3d pt2 = new Point3d(start.X + this.length, start.Y, start.Z + dz);
      Point3d pt3 = new Point3d(pt2.X, pt2.Y + this.dis, pt2.Z);
      Point3d pt4 = new Point3d(pt3.X, pt3.Y, pt3.Z - dz);
      Point3d pt5 = new Point3d(pt4.X - this.length, pt4.Y, pt4.Z + dz);
      Point3d pt6 = new Point3d(pt5.X, pt5.Y + this.dis, pt5.Z);

      poly.Add(pt2);
      poly.Add(pt3);
      poly.Add(pt4);
      poly.Add(pt5);
      poly.Add(pt6);
      poly.Add(this.end);

      return poly;
    }
  }

  //A method to draw multiple weaving pattern.
  public Polyline MulWeaving(Weaving w, int n){
    int i = 0;
    Polyline poly = new Polyline();
    while (i < n){
      Polyline result = w.DrawOne();
      poly.AddRange(result);
      w.ChangeStart();
      i++;
    }
    return poly;
  }
# ---------- end c_script ----------
curve = Curve(c_script.B)
panel = Panel(c_script.timecost)
point_2 = Point(c_script.A)
point_list = PointList(Points=c_script.A, Size=Slider(0.2, range=0..10))

radius = Slider(0.285, range=0..2)
panel_2 = Panel("milling sphere radius")

explode = Explode(Curve=c_script.polyline, Recursive=True)  # -> flatten(Segments), Vertices
pipe = Pipe(Curve=explode.Segments, Radius=radius, Caps=2)  # -> flatten(Pipe)

panel_3 = Panel("milling solid viewer")

# ----
# This takes time!!! save everying before you enable this component. milling solid maker
milling_solid_maker = CSharpScript(b=pipe)  # -> out, A; inputs b: list of Brep; disabled
# ---------- milling_solid_maker: C# ----------
    int i;

    if(b.Count > 0){
      Brep myBrep = b[0];
      for(i = 1; i < b.Count ; i++){
        List<Brep> tempb = new List<Brep>();
        tempb.Add(myBrep);
        tempb.Add(b[i]);
        if(Rhino.Geometry.Brep.CreateBooleanUnion(tempb, 0.001) != null){
          Brep[] bb = Brep.CreateBooleanUnion(tempb, 0.001, true);
          myBrep = bb[0];
        }else Print("" + i);
      }

      A = myBrep;
    }
# ---------- end milling_solid_maker ----------
brep = Brep(milling_solid_maker.A)
