# Grasshopper definition 01_EXE_part2_input.gh (Grasshopper 1.0.7)

crv = Curve(reparameterize(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))
divide = DivideCurve(Curve=crv, Count=30, Kinks=False)  # -> Points, Tangents, Parameters
pdecon = Deconstruct(Point=divide.Points)  # -> XComponent, YComponent, ZComponent

lng = ListLength(List=pdecon.YComponent)
panel = Panel(lng)
panel_2 = Panel(pdecon.YComponent)

c_script = CSharpScript(L=pdecon.YComponent, N=Slider(13, range=0..30))  # -> out, fifthItem, nthItem, max, min, maxAbs, indexMax, sortedList, posNum; inputs L: list of Double, N: Int32
# ---------- c_script: C# usings ----------
using System.IO;
using System.Linq;
using System.Data;
using System.Drawing;
using System.Reflection;
using System.Windows.Forms;
using System.Xml;
using System.Xml.Linq;
using System.Runtime.InteropServices;

using Rhino.DocObjects;
using Rhino.Collections;
using GH_IO;
using GH_IO.Serialization;
# ---------- c_script: C# ----------
    fifthItem = L[5];
    nthItem = L[N];
    max = L.Max();
    min = L.Min();
    maxAbs = MaxAbs(L);
    double maxNum = L.Max();
    indexMax = L.IndexOf(maxNum);
    L.Sort();
    sortedList = L;
    posNum = PosNum(L);
# ---------- c_script: C# additional code ----------
  public double MaxAbs (List<double> L) {
    List<double> newList = new List<double>();

    for (int i = 0;i < L.Count();i++) {
      double n = Math.Abs(L[i]);
      newList.Add(n);
    }
    double maxNum = newList.Max();
    return maxNum;
  }

  public List<double> PosNum(List<double> L) {
    List<double> result = new List<double>();
    for (int i = 0;i < L.Count();i++) {
      if (L[i] > 0) {
        result.Add(L[i]);
      }
    }
    return result;
  }
# ---------- end c_script ----------
panel_3 = Panel(c_script.fifthItem)

panel_4 = Panel(c_script.max)
panel_5 = Panel(c_script.nthItem)
panel_6 = Panel(c_script.min)
panel_7 = Panel(c_script.maxAbs)
panel_8 = Panel(c_script.indexMax)
panel_9 = Panel(c_script.sortedList)
panel_10 = Panel(c_script.posNum)
