# Grasshopper definition 2_exe2.gh (Grasshopper 1.0.7)

pt = Point(Point(0, 0, 0))
pt_2 = Point(Point(-5.096521498, 44.47391302, 0))
number_slider = Slider(6, range=0..100)
number_slider_2 = Slider(6, range=0..100)
c_script = CSharpScript(rx=number_slider_2, ry=number_slider)  # -> out, A, B; inputs rx: Int32, ry: Int32
# ---------- c_script: C# ----------
    List<Point3d> lst = MakeGrid(rx, ry);
    List<Line> result = MakeDiagonalLine(lst, rx, ry);
    A = result;
    B = lst;
# ---------- c_script: C# additional code ----------
  public List<Point3d> MakeGrid (int x, int y) {
    List<Point3d> newlst = new List<Point3d>();
    for (int i = 0; i < x; i++) {
      for (int j = 0; j < y; j++) {
        newlst.Add(new Point3d(i, j, 0.0));

      }
    }
    return newlst;
  }
  public List<Line> MakeDiagonalLine (List<Point3d> lst, int x, int y) {
    List<Line> newlst = new List<Line>();
    foreach (Point3d p in lst) {
      if (p.Y < y - 1 && p.X < x - 1) {
        double newx = p.X + 1;
        double newy = p.Y + 1;
        Point3d newpt = new Point3d(newx, newy, 0.0);
        newlst.Add(new Line(p, newpt));
      }
    }
    return newlst;
  }
# ---------- end c_script ----------
c_script_2 = CSharpScript(rx=number_slider_2, ry=number_slider, minp=pt, maxp=pt_2, dist=Slider(30, range=0..100))  # -> out, A, B; inputs rx: Int32, ry: Int32, minp: Point3d, maxp: Point3d, dist: Double
# ---------- c_script_2: C# ----------
    List<List<Point3d>> lst = MakeGridDemote(rx, ry, minp, maxp);
    List<Point3d> pts = DrawPoint(lst);
    List<Line> lne = DrawAllLine(lst, dist, minp, maxp);
    A = pts;
    B = lne;
# ---------- c_script_2: C# additional code ----------
  //Constructor for point grid.
  public List<List<Point3d>> MakeGridDemote (int x, int y, Point3d min, Point3d max) {
    List<List<Point3d>> outerLst = new List<List<Point3d>>(); //Each column is an individual list.
    double intervalx = (max.X - min.X) / ((double) x - 1.0);
    double intervaly = (max.Y - min.Y) / ((double) y - 1.0);
    for (int i = 0; i < x; i++) {
      List<Point3d> newlst = new List<Point3d>();
      for (int j = 0; j < y; j++) {
        newlst.Add(new Point3d(i * intervalx + min.X, j * intervaly + min.Y, 0.0));
      }
      outerLst.Add(newlst);
    }
    return outerLst;
  }
  //Separate constructor and drawing method.
  public List<Point3d> DrawPoint (List<List<Point3d>> lst) {
    List<Point3d> pts = new List<Point3d>();
    foreach (List<Point3d> item in lst) {
      foreach(Point3d i in item) {
        pts.Add(i);
      }
    }
    return pts;
  }
  //Line drawing method.
  public List<Line> DrawAllLine (List<List<Point3d>> lst, double dist, Point3d min, Point3d max) {
    List<Line> lne = new List<Line>();
    double x = min.X - max.X;
    double y = min.Y - max.Y;
    double distOfPts = Math.Sqrt(Math.Pow(x, 2.0) + Math.Pow(y, 2.0));
    if (dist > distOfPts) {
      foreach (List<Point3d> ptslst in lst) {
        int i = lst.IndexOf(ptslst);
        while (i < lst.Count) {
          foreach (Point3d pts in ptslst) {
            for (int m = 0; m < ptslst.Count; m++)
              lne.Add(new Line(pts, lst[i][m]));
          }
          i++;
        }
      }

    }
    return lne;
  }
# ---------- end c_script_2 ----------
number_slider_3 = Slider(0, range=0..1)
number_slider_4 = Slider(0, range=-3..3)
c_script_3 = CSharpScript(rx=number_slider_2, ry=number_slider)  # -> out, A, B; inputs rx: Int32, ry: Int32; disabled
# ---------- c_script_3: C# ----------
    List<List<Point3d>> lst = MakeGridDemote(rx, ry, interval);
    List<Point3d> pts = DrawPoint(lst);
    List<Line> lne = DrawDiagonalLineDouble(lst);
    A = pts;
    B = lne;
# ---------- c_script_3: C# additional code ----------
  //Constructor for point grid.
  private double interval = 1.0;
  public List<List<Point3d>> MakeGridDemote (int x, int y, double interval) {
    List<List<Point3d>> outerLst = new List<List<Point3d>>(); //Each column is an individual list.
    for (int i = 0; i < x; i++) {
      List<Point3d> newlst = new List<Point3d>();
      for (int j = 0; j < y; j++) {
        newlst.Add(new Point3d(i, j, 0.0));
      }
      outerLst.Add(newlst);
    }
    return outerLst;
  }

  //Separate constructor and drawing method.
  public List<Point3d> DrawPoint (List<List<Point3d>> lst) {
    List<Point3d> pts = new List<Point3d>();
    foreach (List<Point3d> item in lst) {
      foreach(Point3d i in item) {
        pts.Add(i);
      }
    }
    return pts;
  }

  //Line drawing method.
  public List<Line> DrawDiagonalLineDouble (List<List<Point3d>> lst) {
    List<Line> lne = new List<Line>();
    foreach (List<Point3d> ptslst in lst) {
      int i = lst.IndexOf(ptslst);
      if (i < lst.Count - 1) {
        foreach (Point3d pts in ptslst) {
          int k = ptslst.IndexOf(pts);
          if (k < ptslst.Count - 1) {
            lne.Add(new Line(pts, lst[i + 1][k + 1])); // Lines are constructed diagonally.
          }
        }
      }
      if (i > 0) {
        foreach (Point3d pts2 in ptslst) {
          int m = ptslst.IndexOf(pts2);
          if (m < ptslst.Count - 1) {
            lne.Add(new Line(pts2, lst[i - 1][m + 1])); // Reversed.
          }
        }
      }
    }
    return lne;
  }
# ---------- end c_script_3 ----------
c_script_4 = CSharpScript(rx=number_slider_2, ry=number_slider)  # -> out, A; inputs rx: Int32, ry: Int32; disabled
# ---------- c_script_4: C# ----------
    List<List<Point3d>> lst = MakeGridBounded(rx, ry);
    List<Point3d> pts = DrawPoint(lst);
    A = pts;
# ---------- c_script_4: C# additional code ----------
  //Constructor for point grid.
  public List<List<Point3d>> MakeGridBounded (int x, int y) {
    List<List<Point3d>> outerLst = new List<List<Point3d>>(); //Each column is an individual list.
    double interval = 1.0 / ((double)y-1.0);
    for (int i = 0; i < x; i++) {
      List<Point3d> newlst = new List<Point3d>();
      for (double j = 0; j < 1.0; j+= interval) {
        newlst.Add(new Point3d(i, j+2.0, 0.0));
      }
      outerLst.Add(newlst);
    }
    return outerLst;
  }
  //Separate constructor and drawing method.
  public List<Point3d> DrawPoint (List<List<Point3d>> lst) {
    List<Point3d> pts = new List<Point3d>();
    foreach (List<Point3d> item in lst) {
      foreach(Point3d i in item) {
        pts.Add(i);
      }
    }
    return pts;
  }
# ---------- end c_script_4 ----------
c_script_5 = CSharpScript(rx=number_slider_2, ry=number_slider)  # -> out, A; inputs rx: Int32, ry: Int32
# ---------- c_script_5: C# ----------
    List<List<Point3d>> lst = MakeGrid(rx, ry);
    List<Point3d> pts = DrawPoint(lst);
    A = pts;
# ---------- c_script_5: C# additional code ----------
  //Constructor for point grid.
  public List<List<Point3d>> MakeGrid (int x, int y) {
    List<List<Point3d>> outerLst = new List<List<Point3d>>(); //Each column is an individual list.
    for (int i = 0; i < x; i++) {
      List<Point3d> newlst = new List<Point3d>();
      for (int j = 0; j < y; j++) {
        newlst.Add(new Point3d(i, j, 0.0));
      }
      outerLst.Add(newlst);
    }
    return outerLst;
  }
  //Separate constructor and drawing method.
  public List<Point3d> DrawPoint (List<List<Point3d>> lst) {
    List<Point3d> pts = new List<Point3d>();
    foreach (List<Point3d> item in lst) {
      foreach(Point3d i in item) {
        pts.Add(i);
      }
    }
    return pts;
  }
# ---------- end c_script_5 ----------
c_script_6 = CSharpScript(rx=number_slider_2, ry=number_slider)  # -> out, A; inputs rx: Int32, ry: Int32
# ---------- c_script_6: C# ----------
    List<Point3d> lst = MakeGrid(rx, ry);
    A = lst;
# ---------- c_script_6: C# additional code ----------
  public List<Point3d> MakeGrid (int x, int y) {
    List<Point3d> newlst = new List<Point3d>();
    for (int i = 0; i < x; i++) {
      for (int j = 0; j < y; j++) {
        newlst.Add(new Point3d(i * 4, j * 2, 0.0));
      }
    }
    return newlst;
  }
# ---------- end c_script_6 ----------
c_script_7 = CSharpScript(rx=number_slider_2, ry=number_slider)  # -> out, A, B; inputs rx: Int32, ry: Int32; disabled
# ---------- c_script_7: C# ----------
    List<List<Point3d>> lst = MakeGridDemote(rx, ry, interval);
    List<Point3d> pts = DrawPoint(lst);
    List<Line> lne = DrawDiagonalLine(lst);
    A = pts;
    B = lne;
# ---------- c_script_7: C# additional code ----------
  //Constructor for point grid.
  private double interval = 1.0;
  public List<List<Point3d>> MakeGridDemote (int x, int y, double interval) {
    List<List<Point3d>> outerLst = new List<List<Point3d>>(); //Each column is an individual list.
    for (int i = 0; i < x; i++) {
      List<Point3d> newlst = new List<Point3d>();
      for (int j = 0; j < y; j++) {
        newlst.Add(new Point3d(i, j, 0.0));
      }
      outerLst.Add(newlst);
    }
    return outerLst;
  }
  //Separate constructor and drawing method.
  public List<Point3d> DrawPoint (List<List<Point3d>> lst) {
    List<Point3d> pts = new List<Point3d>();
    foreach (List<Point3d> item in lst) {
      foreach(Point3d i in item) {
        pts.Add(i);
      }
    }
    return pts;
  }
  //Line drawing method.
  public List<Line> DrawDiagonalLine (List<List<Point3d>> lst) {
    List<Line> lne = new List<Line>();
    foreach (List<Point3d> ptslst in lst) {
      int i = lst.IndexOf(ptslst);
      if (i < lst.Count - 1) {
        foreach (Point3d pts in ptslst) {
          int k = ptslst.IndexOf(pts);
          if (k < ptslst.Count - 1) {
            lne.Add(new Line(pts, lst[i + 1][k + 1]));
          }
        }
      }
    }
    return lne;
  }
# ---------- end c_script_7 ----------
pt_3 = Point(Point(1.22, 2.33, 0))
c_script_8 = CSharpScript(rx=number_slider_2, ry=number_slider, minp=pt, maxp=pt_2, param1=number_slider_3, param2=number_slider_4)  # -> out, A, B; inputs rx: Int32, ry: Int32, minp: Point3d, maxp: Point3d, param1: Double, param2: Double
# ---------- c_script_8: C# ----------
    List<List<Point3d>> lst = MakeGridDemote(rx, ry, minp, maxp);
    List<Point3d> pts = DrawPoint(lst);
    List<Line> lne = DrawOrthoLine(lst);
    A = pts;
    B = lne;
# ---------- c_script_8: C# additional code ----------
  //Constructor for point grid.
  public List<List<Point3d>> MakeGridDemote (int x, int y, Point3d min, Point3d max) {
    List<List<Point3d>> outerLst = new List<List<Point3d>>(); //Each column is an individual list.
    double intervalx = (max.X - min.X) / ((double) x - 1.0);
    double intervaly = (max.Y - min.Y) / ((double) y - 1.0);
    for (int i = 0; i < x; i++) {
      List<Point3d> newlst = new List<Point3d>();
      for (int j = 0; j < y; j++) {
        newlst.Add(new Point3d(i * intervalx + min.X, j * intervaly + min.Y, 0.0));
      }
      outerLst.Add(newlst);
    }
    return outerLst;
  }
  //Separate constructor and drawing method.
  public List<Point3d> DrawPoint (List<List<Point3d>> lst) {
    List<Point3d> pts = new List<Point3d>();
    foreach (List<Point3d> item in lst) {
      foreach(Point3d i in item) {
        pts.Add(i);
      }
    }
    return pts;
  }
  //Line drawing method.
  public List<Line> DrawOrthoLine (List<List<Point3d>> lst) {
    List<Line> lne = new List<Line>();

    foreach (List<Point3d> ptlst in lst){
      int i = lst.IndexOf(ptlst);
      if (i < lst.Count - 1) {
        foreach (Point3d pts in ptlst) {
          int k = ptlst.IndexOf(pts);
          if (k < ptlst.Count - 1) {
            lne.Add(new Line(pts, ptlst[k + 1]));
            lne.Add(new Line(pts, lst[i + 1][k]));
          } else {
            lne.Add(new Line(pts, lst[i + 1][k]));
          }
        }
      } else {
        for (int j = 0; j < ptlst.Count - 1; j++){
          lne.Add(new Line(ptlst[j], ptlst[j + 1]));
        }
      }
    }
    return lne;
  }
# ---------- end c_script_8 ----------
pt_4 = Point(Point(10, 100, 0))
panel = Panel(c_script_5.A)
panel_2 = Panel(c_script_8.A)
c_script_9 = CSharpScript(rx=number_slider_2, ry=number_slider)  # -> out, A, B; inputs rx: Int32, ry: Int32
# ---------- c_script_9: C# ----------
    List<List<Point3d>> lst = MakeGridDemote(rx, ry, interval);
    List<Point3d> pts = DrawPoint(lst);
    List<Line> lne = DrawOrthoLine(lst);
    A = pts;
    B = lne;
# ---------- c_script_9: C# additional code ----------
  private double interval = 1.0;
  //Constructor for point grid.
  public List<List<Point3d>> MakeGridDemote (int x, int y, double interval) {
    List<List<Point3d>> outerLst = new List<List<Point3d>>(); //Each column is an individual list.
    for (double i = 0.0; i < (double) x; i += interval) {
      List<Point3d> newlst = new List<Point3d>();
      for (double j = 0.0; j < (double) y; j += interval) {
        newlst.Add(new Point3d(i, j, 0.0));
      }
      outerLst.Add(newlst);
    }
    return outerLst;
  }
  //Separate constructor and drawing method.
  public List<Point3d> DrawPoint (List<List<Point3d>> lst) {
    List<Point3d> pts = new List<Point3d>();
    foreach (List<Point3d> item in lst) {
      foreach(Point3d i in item) {
        pts.Add(i);
      }
    }
    return pts;
  }
  //Line drawing method.
  public List<Line> DrawOrthoLine (List<List<Point3d>> lst) {
    List<Line> lne = new List<Line>();

    foreach (List<Point3d> ptlst in lst){
      int i = lst.IndexOf(ptlst);
      if (i < lst.Count - 1) {
        foreach (Point3d pts in ptlst) {
          int k = ptlst.IndexOf(pts);
          if (k < ptlst.Count - 1) {
            lne.Add(new Line(pts, ptlst[k + 1]));
            lne.Add(new Line(pts, lst[i + 1][k]));
          } else {
            lne.Add(new Line(pts, lst[i + 1][k]));
          }
        }
      } else {
        for (int j = 0; j < ptlst.Count - 1; j++){
          lne.Add(new Line(ptlst[j], ptlst[j + 1]));
        }
      }
    }
    return lne;
  }
# ---------- end c_script_9 ----------
number_slider_5 = Slider(5, range=0..20)
number_slider_6 = Slider(16, range=0..100)
srfgrid = SurfaceFromPoints(Points=c_script_8.A, UCount=number_slider, Interpolate=False)
c_script_10 = CSharpScript(rx=number_slider_2, ry=number_slider, minp=pt_3, maxp=pt_4, param1=number_slider_3, param2=number_slider_4)  # -> out, A, B; inputs rx: Int32, ry: Int32, minp: Point3d, maxp: Point3d, param1: Double, param2: Double; same code as c_script_8
c_script_11 = CSharpScript(rx=number_slider_2, ry=number_slider, minp=pt, maxp=pt_2, param1=number_slider_3, param2=number_slider_4)  # -> out, A, B; inputs rx: Int32, ry: Int32, minp: Point3d, maxp: Point3d, param1: Double, param2: Double; same code as c_script_8
preview = CustomPreview(Geometry=srfgrid, Material=ColourSwatch(SwatchColor=RGB(129, 123, 255)))
vec = Vector(Vector(6.563330253, 5.636942638, 0))
c_script_12 = CSharpScript(res=number_slider_5, size=number_slider_6)  # -> out, A, B; inputs res: Int32, size: Double
# ---------- c_script_12: C# ----------
    List<List<Point3d>> ptsLst = MakeGrid(res, size);
    List<List<Point3d>> midPtsLst = MakeMidPtGrid(ptsLst);

    List<Point3d> outerPts = DrawPoint(ptsLst);
    List<Line> lne = DrawOrthoLine(ptsLst);

    List<Point3d> midPts = DrawPoint(midPtsLst);
    //List<Line> midLne = DrawOrthoLine(midPtsLst);
    A = outerPts;
    B = midPts;
# ---------- c_script_12: C# additional code ----------
  //Constructor for point grid.
  public List<List<Point3d>> MakeGrid (int res, double size) {
    List<List<Point3d>> outerLst = new List<List<Point3d>>(); //Each column is an individual list.
    double interval = size / ((double) res - 1);
    for (int i = 0; i < res; i++) {
      List<Point3d> newlst = new List<Point3d>();
      for (int j = 0; j < res; j++) {
        newlst.Add(new Point3d(i * interval, j * interval, 0.0));
      }
      outerLst.Add(newlst);
    }
    return outerLst;
  }

  public List<List<Point3d>> MakeMidPtGrid (List<List<Point3d>> lst) {
    List<List<Point3d>> outerLst = new List<List<Point3d>>();
    foreach (List<Point3d> ptlst in lst) {
      List<Point3d> newlst = new List<Point3d>();
      int i = lst.IndexOf(ptlst);
      if (i < lst.Count - 1) {
        foreach (Point3d pts in ptlst) {
          int k = ptlst.IndexOf(pts);
          if (k < ptlst.Count - 1) {
            double newX = (lst[i + 1][k + 1].X - pts.X) / 2.0;
            double newY = (lst[i + 1][k + 1].Y - pts.Y) / 2.0;
            newlst.Add(new Point3d(newX, newY, 0.0));
          }
        }
      }
      outerLst.Add(newlst);
    }
    return outerLst;
  }

  //Separate constructor and point drawing method.
  public List<Point3d> DrawPoint (List<List<Point3d>> lst) {
    List<Point3d> pts = new List<Point3d>();
    foreach (List<Point3d> item in lst) {
      foreach(Point3d i in item) {
        pts.Add(i);
      }
    }
    return pts;
  }

  //Line drawing method.
  public List<Line> DrawOrthoLine (List<List<Point3d>> lst) {
    List<Line> lne = new List<Line>();

    foreach (List<Point3d> ptlst in lst){
      int i = lst.IndexOf(ptlst);
      if (i < lst.Count - 1) {
        foreach (Point3d pts in ptlst) {
          int k = ptlst.IndexOf(pts);
          if (k < ptlst.Count - 1) {
            lne.Add(new Line(pts, ptlst[k + 1]));
            lne.Add(new Line(pts, lst[i + 1][k]));
          } else {
            lne.Add(new Line(pts, lst[i + 1][k]));
          }
        }
      } else {
        for (int j = 0; j < ptlst.Count - 1; j++){
          lne.Add(new Line(ptlst[j], ptlst[j + 1]));
        }
      }
    }
    return lne;
  }
# ---------- end c_script_12 ----------
pt_5 = Point(Point(0, 0, 1))
pt_6 = Point(Point(1, 0, 0))
pt_7 = Point(Point(0, 1, 0))
c_script_13 = CSharpScript(res=number_slider_5, size=number_slider_6)  # -> out, A, B, C; inputs res: Int32, size: Double
# ---------- c_script_13: C# ----------
    Grid g = new Grid(res, size);
    A = g.DrawGridPts();

    C = g.DrawGridLne();
    Grid small = g.MidPtGrid();

    B = small.DrawGridLne();
# ---------- c_script_13: C# additional code ----------
  //An enum for documenting the positional status of each Coordinate.
  public enum Position {
    Inner,
    OuterX,
    OuterY,
    Vertex
  }

  //A Coordinate class that documents a point coordinate and its X,Y indices.
  class Coordinate {
    public int iX, iY;
    public Point3d origin;
    public Position pos {get;set;}

    public void ChangePosStatus(Position p) {
      this.pos = p;
    }

    public Coordinate() {
      iX = 0;
      iY = 0;
      origin = new Point3d(0.0, 0.0, 0.0);
    }
    public Coordinate(int x, int y, Point3d pt) {
      this.iX = x;
      this.iY = y;
      this.origin = pt;
    }
    public void ChangeIndex (int x, int y) {
      this.iX = x;
      this.iY = y;
    }
    public Point3d DrawPt() {
      return this.origin;
    }
    public void Translate (Vector3d v) {
      this.origin = this.origin + v;
    }
  }

  //A grid class that is defined by int res, double size, and a list of Coordinates.
  class Grid {
    public double size;
    public int res;
    public List<Coordinate> cLst = new List<Coordinate>();

    public Grid() {
      size = 0.0;
      res = 0;
    }

    public Grid(int res, double size) {
      this.size = size;
      this.res = res;
      double interval = size / (res - 1);
      List<Coordinate> cLst = new List<Coordinate>();
      for (int i = 0; i < res; i++) {
        for (int j = 0; j < res; j++) {
          Coordinate c = new Coordinate(i, j, new Point3d(i * interval, j * interval, 0.0));
          if (c.iX == res - 1 && c.iY == res - 1) {
            c.ChangePosStatus(Position.Vertex);
          } else if(c.iX == res - 1 && c.iY < res - 1) {
            c.ChangePosStatus(Position.OuterX);
          } else if (c.iY == res - 1 && c.iX < res - 1) {
            c.ChangePosStatus(Position.OuterY);
          } else {
            c.ChangePosStatus(Position.Inner);
          }
          cLst.Add(c);
        }
      }
      this.cLst = cLst;
    }

    public void ChangeRes(int r) {
      this.res = r;
      foreach (Coordinate c in this.cLst) {
        if (c.iX == r - 1 && c.iY == r - 1) {
          c.ChangePosStatus(Position.Vertex);
        } else if(c.iX == r - 1 && c.iY < r - 1) {
          c.ChangePosStatus(Position.OuterX);
        } else if (c.iY == r - 1 && c.iX < r - 1) {
          c.ChangePosStatus(Position.OuterY);
        } else {
          c.ChangePosStatus(Position.Inner);
        }
      }
    }

    public void ChangeSize(double s) {
      this.size = s;
    }

    public Coordinate GetCoordinate(int x, int y) {
      List<Coordinate> cLst = this.cLst;
      foreach (Coordinate c in cLst) {
        if (c.iX == x && c.iY == y) {
          return c;
        }
      }
      return new Coordinate();
    }

    public List<Point3d> DrawGridPts() {
      List<Coordinate> newLst = this.cLst;
      List<Point3d> result = new List<Point3d>();
      foreach (Coordinate item in newLst) {
        result.Add(item.DrawPt());
      }
      return result;
    }

    public void TranslateGrid(Vector3d v) {
      foreach (Coordinate c in this.cLst) {
        c.origin = c.origin + v;
      }
    }

    public Grid MidPtGrid() {
      Grid newGrid = new Grid();
      newGrid.ChangeSize(this.size * (this.res - 1) / this.res);
      foreach (Coordinate c in this.cLst) {
        switch (c.pos) {
          case Position.Vertex:
            break;
          case Position.OuterX:
            break;
          case Position.OuterY:
            break;
          case Position.Inner:
            newGrid.cLst.Add(c);
            break;
        }
      }
      newGrid.ChangeRes(this.res - 1);
      Coordinate first = this.cLst[0];
      Coordinate next = this.GetCoordinate(1, 1);
      Vector3d v = new Vector3d((next.origin.X - first.origin.X) / 2.0, (next.origin.Y - first.origin.Y) / 2.0, 0.0);
      newGrid.TranslateGrid(v);
      return newGrid;
    }

    public List<Line> DrawGridLne() {
      List<Coordinate> newLst = this.cLst;
      List<Line> result = new List<Line>();
      foreach (Coordinate item in newLst) {
        switch (item.pos) {
          case Position.Vertex:
            break;
          case Position.Inner:
            Coordinate next = this.GetCoordinate(item.iX, item.iY + 1);
            Coordinate next1 = this.GetCoordinate(item.iX + 1, item.iY);
            result.Add(new Line(item.origin, next.origin));
            result.Add(new Line(item.origin, next1.origin));
            break;
          case Position.OuterY:
            Coordinate next2 = this.GetCoordinate(item.iX + 1, item.iY);
            result.Add(new Line(item.origin, next2.origin));
            break;
          case Position.OuterX:
            Coordinate next3 = this.GetCoordinate(item.iX, item.iY + 1);
            result.Add(new Line(item.origin, next3.origin));
            break;
        }
      }
      return result;
    }
  }

  //A Spaceframe class defined by outer and inner grids and strauts.
  class Spaceframe {
    
  }
# ---------- end c_script_13 ----------
c_script_14 = CSharpScript(rx=number_slider_2, ry=number_slider, vec=vec)  # -> out, A; inputs rx: Int32, ry: Int32, vec: Vector3d
# ---------- c_script_14: C# ----------
    List<Point3d> lst = MakeGrid(rx, ry, vec);
    A = lst;
# ---------- c_script_14: C# additional code ----------
  public List<Point3d> MakeGrid (int x, int y, Vector3d vec) {
    List<Point3d> newlst = new List<Point3d>();
    List<Point3d> vlst = new List<Point3d>();
    for (int i = 0; i < x; i++) {
      for (int j = 0; j < y; j++) {
        newlst.Add(new Point3d(i, j, 0.0));
      }
    }
    foreach (Point3d pts in newlst) {
      Point3d newpts = pts + vec;
      vlst.Add(newpts);
    }
    return vlst;
  }
# ---------- end c_script_14 ----------
c_script_15 = CSharpScript()  # -> Out, A
c_script_16 = CSharpScript(x=pt_7, y=pt_6, z=pt_5)  # -> out, A; inputs x: Point3d, y: Point3d, z: Point3d
# ---------- c_script_16: C# ----------
    A = UnitNormal(x, y, z);
# ---------- c_script_16: C# additional code ----------
  public Vector3d UnitNormal (Point3d p1, Point3d p2, Point3d p3) {
    Vector3d v1 = p2 - p1;
    Vector3d v2 = p3 - p1;
    Vector3d n = Vector3d.CrossProduct(v1, v2);
    n.Unitize();
    return n;
  }
# ---------- end c_script_16 ----------
c_script_17 = CSharpScript(x=pt_7, y=pt_6, z=pt_5)  # -> out, A; inputs x: Point3d, y: Point3d, z: Point3d
# ---------- c_script_17: C# ----------
    A = VectorAngle(x, y, z);
# ---------- c_script_17: C# additional code ----------
  public double VectorAngle (Point3d p1, Point3d p2, Point3d p3) {
    Vector3d v1 = p2 - p1;
    Vector3d v2 = p3 - p1;
    double a = Vector3d.VectorAngle(v1, v2);
    a = Math.Acos((v1 * v2) / (v1.Length* v2.Length));
    a *= 180.0 / Math.PI;

    return a;
  }
# ---------- end c_script_17 ----------
panel_3 = Panel(c_script_12.A)
panel_4 = Panel(c_script_13.A)
panel_5 = Panel(c_script_12.out)
panel_6 = Panel(c_script_12.B)
panel_7 = Panel(c_script_13.B)
panel_8 = Panel(c_script_16.A)
panel_9 = Panel(c_script_17.A)
