# Grasshopper definition Week4_YuboZhao.gh (Grasshopper 1.0.7)

c_script = CSharpScript(res=Slider(6, range=0..20), size=Slider(30, range=0..100))  # -> out, A; inputs res: Int32, size: Double
# ---------- c_script: C# ----------
    Spaceframe s = new Spaceframe(res, size);
    A = s.DrawSpaceframe();
# ---------- c_script: C# additional code ----------
  /*
  DESCRIPTION!!!
  ------------------
  A Coordinate class documents a point with its Point3d coordinate, and its two indices iX and
  iY which represent its index in the Grid. It also has a property of Position status which
  lets us know whether the Coordinate is at the edge of the Grid.
  ------------------
  A Grid class documents a list of Coordinates and has methods of drawing the cluster of Coordinates
  as a point grid and as a line grid.
  ------------------
  A Spaceframe class is comprised of two grids (outer the big one and inner the small one) and a
  List<Line> of struts that connect two grid. It also has a drawing method which can display all
  structures in a list of line.
  */

  //An enum for documenting the positional status of each Coordinate.
  public enum Position {
    Inner,
    OuterX,
    OuterY,
    Vertex
  }

  //A Coordinate class that documents a point coordinate and its X,Y indices.
  class Coordinate {
    public int iX, iY;
    public Point3d origin;
    private Position pos;

    public Coordinate() {
      iX = 0;
      iY = 0;
      origin = new Point3d(0.0, 0.0, 0.0);
    }
    public Coordinate(int x, int y, Point3d pt) {
      this.iX = x;
      this.iY = y;
      this.origin = pt;
    }
    public void ChangePosStatus(Position p) {
      this.pos = p;
    }
    public Position GetPos() {
      return this.pos;
    }
    public void ChangeIndex (int x, int y) {
      this.iX = x;
      this.iY = y;
    }
    public Point3d DrawPt() {
      return this.origin;
    }
    public void Translate (Vector3d v) {
      this.origin = this.origin + v;
    }
  }

  //A grid class that is defined by int res, double size, and a list of Coordinates.
  class Grid {
    public double size;
    public int res;
    public List<Coordinate> cLst = new List<Coordinate>();

    public Grid() {
      size = 0.0;
      res = 0;
    }
    //Constructor of Grid.
    public Grid(int res, double size) {
      this.size = size;
      this.res = res;
      double interval = size / (res - 1);
      List<Coordinate> cLst = new List<Coordinate>();
      for (int i = 0; i < res; i++) {
        for (int j = 0; j < res; j++) {
          Coordinate c = new Coordinate(i, j, new Point3d(i * interval, j * interval, 0.0));
          //Assign the Position status to every Coordinate in the Grid.
          if (c.iX == res - 1 && c.iY == res - 1) {
            c.ChangePosStatus(Position.Vertex);
          } else if(c.iX == res - 1 && c.iY < res - 1) {
            c.ChangePosStatus(Position.OuterX);
          } else if (c.iY == res - 1 && c.iX < res - 1) {
            c.ChangePosStatus(Position.OuterY);
          } else {
            c.ChangePosStatus(Position.Inner);
          }
          cLst.Add(c);
        }
      }
      this.cLst = cLst;
    }

    //Change the value of res and adjust the Position status of each Coordinate.
    public void ChangeRes(int r) {
      this.res = r;
      foreach (Coordinate c in this.cLst) {
        if (c.iX == r - 1 && c.iY == r - 1) {
          c.ChangePosStatus(Position.Vertex);
        } else if(c.iX == r - 1 && c.iY < r - 1) {
          c.ChangePosStatus(Position.OuterX);
        } else if (c.iY == r - 1 && c.iX < r - 1) {
          c.ChangePosStatus(Position.OuterY);
        } else {
          c.ChangePosStatus(Position.Inner);
        }
      }
    }

    public void ChangeSize(double s) {
      this.size = s;
    }

    public Coordinate GetCoordinate(int x, int y) {
      List<Coordinate> cLst = this.cLst;
      foreach (Coordinate c in cLst) {
        if (c.iX == x && c.iY == y) {
          return c;
        }
      }
      return new Coordinate();
    }

    //The drawing method to create points.
    public List<Point3d> DrawGridPts() {
      List<Coordinate> newLst = this.cLst;
      List<Point3d> result = new List<Point3d>();
      foreach (Coordinate item in newLst) {
        result.Add(item.DrawPt());
      }
      return result;
    }

    //Translation method.
    public void TranslateGrid(Vector3d v) {
      foreach (Coordinate c in this.cLst) {
        c.origin = c.origin + v;
      }
    }

    //To create a new Grid that is defined by midpoints.
    public Grid MidPtGrid() {
      Grid newGrid = new Grid();
      newGrid.ChangeSize(this.size * (this.res - 1) / this.res);
      Coordinate first = this.cLst[0];
      Coordinate next = this.GetCoordinate(first.iX + 1, first.iY + 1);
      double newX = (next.origin.X - first.origin.X) / 2.0;
      double newY = (next.origin.Y - first.origin.Y) / 2.0;
      Vector3d v = new Vector3d(newX, newY, 0.0);
      foreach (Coordinate c in this.cLst) {
        if (c.GetPos() == Position.Inner){
          Coordinate newC = new Coordinate(c.iX, c.iY, c.origin);
          newGrid.cLst.Add(newC);
        }
      }
      newGrid.ChangeRes(this.res - 1);
      newGrid.TranslateGrid(v);
      return newGrid;
    }

    //The drawing method to create lines.
    public List<Line> DrawGridLne() {
      List<Coordinate> newLst = new List<Coordinate>();
      foreach (Coordinate c in this.cLst) {
        newLst.Add(c);
      }
      List<Line> result = new List<Line>();
      foreach (Coordinate item in newLst) {
        switch (item.GetPos()) {
          case Position.Vertex:
            break;
          case Position.Inner:
            Coordinate next = this.GetCoordinate(item.iX, item.iY + 1);
            Coordinate next1 = this.GetCoordinate(item.iX + 1, item.iY);
            result.Add(new Line(item.origin, next.origin));
            result.Add(new Line(item.origin, next1.origin));
            break;
          case Position.OuterY:
            Coordinate next2 = this.GetCoordinate(item.iX + 1, item.iY);
            result.Add(new Line(item.origin, next2.origin));
            break;
          case Position.OuterX:
            Coordinate next3 = this.GetCoordinate(item.iX, item.iY + 1);
            result.Add(new Line(item.origin, next3.origin));
            break;
        }
      }
      return result;
    }
  }

  //A Spaceframe class defined by outer and inner grids and strauts.
  class Spaceframe {
    public int outerRes, innerRes;
    public double size;
    public Grid outer = new Grid();
    public Grid inner = new Grid();
    public List<Line> outerFrame = new List<Line>();
    public List<Line> innerFrame = new List<Line>();
    public List<Line> struts = new List<Line>();
    private Vector3d translation = new Vector3d(0.0, 0.0, -1.0);

    public Spaceframe() {
      outerRes = 0;
      innerRes = 0;
      size = 0.0;
    }

    public Spaceframe(int res, double size) {
      this.outerRes = res;
      this.innerRes = res - 1;
      this.size = size;
      this.outer = new Grid(res, size);
      this.outerFrame = this.outer.DrawGridLne();
      this.inner = this.outer.MidPtGrid();
      this.inner.TranslateGrid(translation);
      this.innerFrame = this.inner.DrawGridLne();

      List<Line> struts = new List<Line>();
      foreach (Coordinate c in this.inner.cLst) {
        struts.Add(new Line(c.origin, this.outer.GetCoordinate(c.iX, c.iY).origin));
        struts.Add(new Line(c.origin, this.outer.GetCoordinate(c.iX + 1, c.iY).origin));
        struts.Add(new Line(c.origin, this.outer.GetCoordinate(c.iX, c.iY + 1).origin));
        struts.Add(new Line(c.origin, this.outer.GetCoordinate(c.iX + 1, c.iY + 1).origin));
      }
      this.struts = struts;
    }

    public List<Line> DrawSpaceframe () {
      List<Line> outer = this.outerFrame;
      List<Line> inner = this.innerFrame;
      List<Line> struts = this.struts;
      outer.AddRange(inner);
      outer.AddRange(struts);
      return outer;
    }
  }
# ---------- end c_script ----------
panel = Panel(c_script.A)
